vi "NXGDemo.gvi"   [LabVIEW NXG 4.0.0]
panel controls:
  "Start/Stop": bool
  "Integration Time (ms)": u32 = 100
  "Detector Setpoint (°C)": f32
  "Fire Laser": bool
  "Trigger": bool
panel indicators:
  "XY Graph": T1
  "Coeff0": f64
  "Coeff1": f64
  "Coeff2": f64
  "Coeff3": f64
  "Excitation (nm)": f64
  "Model": string
  "Serial": string
  "Detector TEC (°C)": f64
  "microcontroller FW": string
  "FPGA FW": string
  "Driver Version": string
types:
  T1 = cluster{"wavelengths": f64[], "getSpectrum": f64[]}
uses:
  NXGDemo::WasatchNET.dni::WasatchNET::Driver::getInstance
  NXGDemo::WasatchNET.dni::WasatchNET::Driver::openAllSpectrometers
  NXGDemo::WasatchNET.dni::WasatchNET::Driver::getNumberOfSpectrometers
  NXGDemo::WasatchNET.dni::WasatchNET::Driver::getSpectrometer
  NXGDemo::WasatchNET.dni::WasatchNET::Spectrometer::getSpectrum
  NXGDemo::WasatchNET.dni::WasatchNET::Logger::setPathname
diagram:
  call "getInstance"() -> (return=w1)
  call "openAllSpectrometers"(reference in=w1) -> (reference out=w2)
  call "getNumberOfSpectrometers"(reference in=w2) -> (return=w3, reference out=w4)
  Is Greater(x=w3, y=0) -> w5
  case (w5) {
    frame False, Default {
      One Button Dialog(message="No spectrometers were found")
    }
    frame True {
      call "getSpectrometer"(index=0, reference in=w4) -> (return=w6)
      # Includes events for Trigger, Integration Time, Laser Enable and TEC Setpoint.
      while {
        event {
          on "Trigger" Value changed {
            case ($Trigger) {
              frame False, Default {
                w7 = "INTERNAL"(0)
              }
              frame True {
                w8 = "EXTERNAL"(1)  # triggerSource
                w7 = w8
              }
            }
            Property Node[IsPlaceholderNodeForConversion=True](instance in=w6, "triggerSource"=w7)
          }
          on "Detector Setpoint (°C)" Value changed {
            Property Node[IsPlaceholderNodeForConversion=True](instance in=w6, "detectorTECSetpointDegC"=$"Detector Setpoint (°C)")
          }
          on "Integration Time (ms)" Value changed {
            Property Node[IsPlaceholderNodeForConversion=True](instance in=w6, "integrationTimeMS"=$"Integration Time (ms)")
          }
          on "Fire Laser" Value changed {
            Property Node[IsPlaceholderNodeForConversion=True](instance in=w6, "laserEnabled"=$"Fire Laser")
          }
        }
        stop if FALSE
      }
      Property Node(instance in=w6) -> ("wavelengths"=w9)
      while {
        case ($"Start/Stop") {
          frame False, Default { }
          frame True {
            Property Node[IsPlaceholderNodeForConversion=True](instance in=w6) -> ("detectorTemperatureDegC"=w10)
            $"Detector TEC (°C)" <- w10
            call "getSpectrum"(reference in=w6) -> (return=w11)
            Property Node(instance in=T1 {all zero or empty}, "wavelengths"=w9, "getSpectrum"=w11) -> (instance out=w12)
            $"XY Graph" <- w12
          }
        }
        stop if FALSE
      }
      Property Node(instance in=w6) -> ("serialNumber"=w13)
      $Serial <- w13
      Property Node(instance in=w6) -> ("model"=w14)
      $Model <- w14
      Property Node(instance in=w6) -> ("excitationWavelengthNM"=w15)
      $"Excitation (nm)" <- w15
      Property Node(instance in=w6) -> ("eeprom"=w16)
      Property Node[IsPlaceholderNodeForConversion=True](instance in=w16) -> ("wavecalCoeffs"=w17)
      Array Index(array=w17) -> (out0[0]=w18)
      $Coeff0 <- w18
      Property Node(instance in=w6) -> ("firmwareRevision"=w19)
      $"microcontroller FW" <- w19
      Array Index(array=w17) -> (out0[1]=w20)
      $Coeff1 <- w20
      Property Node(instance in=w6) -> ("fpgaRevision"=w21)
      $"FPGA FW" <- w21
      Array Index(array=w17) -> (out0[2]=w22)
      $Coeff2 <- w22
      Array Index(array=w17) -> (out0[3]=w23)
      $Coeff3 <- w23
      Property Node[IsPlaceholderNodeForConversion=True](instance in=w16) -> ("detectorTempMin"=w24)
      Property Node(instance in=reference to "Detector Setpoint (°C)", "Value"=w24)  # NumericTextBox properties
      Property Node(instance in=reference to "Detector Setpoint (°C)", "Minimum"=w24)  # NumericTextBox properties
      Property Node[IsPlaceholderNodeForConversion=True](instance in=w16) -> ("detectorTempMax"=w25)
      Property Node(instance in=reference to "Detector Setpoint (°C)", "Maximum"=w25)  # NumericTextBox properties
    }
  }
  Property Node(instance in=w1) -> ("logger"=w26)
  Property Node(instance in=w26, "level"="DEBUG"(0)) -> (instance out=w27)
  # Provide any path,
  # but make sure
  # directory exists!
  call "setPathname"(path="C:\\temp\\labview.log", reference in=w27)
  Property Node(instance in=w1) -> ("version"=w28)
  $"Driver Version" <- w28
